# Grasshopper definition Curving Ramp.ghx (Grasshopper 0.6.18)

panel = Panel("Desired ramp gradient")
crv = Curve(<curve referenced from the Rhino model>)
len = Length(C=crv)
f_x_y = F2(F="x/y", x=len, y=Slider(20, range=1..50))
divide = DivideCurve(C=crv, N=Slider(51, range=2..100), K=False)  # -> P, T, t
panel_2 = Panel("Resulting ramp height")
panel_3 = Panel(f_x_y)
vb = DotNETVBScript(Points=divide.P, Height=f_x_y)  # -> out, TranslatedPoints; inputs Points: list
# ---------- vb: VB ----------
    Dim numberOfPoints As Integer = Points.Count()
    Dim heightBetweenPoints As Double = Height / numberOfPoints
    Dim NewPoints As New List(Of On3dPoint)
    
    Dim index As Integer
    For index = 0 To (numberOfPoints - 1)
      Dim existingPoint As On3dPoint = Points(index)
      
      Dim newPoint As New On3dPoint
      newPoint.x = existingPoint.x
      newPoint.y = existingPoint.y
      newPoint.z = existingPoint.z + (heightBetweenPoints * (index + 1))
      
      NewPoints.Add(newPoint)
    Next
    
    TranslatedPoints = NewPoints
# ---------- end vb ----------
intcrv = Interpolate(V=vb.TranslatedPoints, D=3, P=False)  # -> C, L, D
